# Grasshopper definition ACORN-shell.gh (Grasshopper 1.0.7)
# plug-ins: HAL for Grasshopper, karambaGH

sessionsettings = SessionSettings()
rectangle = Rectangle(Plane=PlaneXY(0, 0, 0), XSize="-3.9 to 3.9", YSize="-3.6 to 3.6", Radius=0)  # -> Rectangle, Length
make_plan = GhPythonScript(outline=rectangle.Rectangle, corner_radius=Slider(0.2, range=0..1))  # -> plan, corners, edges; inputs outline: Curve
# ---------- make_plan: Python ----------
import sys

sys.path.insert(1, 'Z:/Documents/ACORN-shells/src')

from acorn_shell.generate import make_2d_plan
plan, corners, edges = make_2d_plan(outline, corner_radius)
# ---------- end make_plan ----------
brep = Brep(make_plan.plan)
form_find = GhPythonScript(plan_surface=brep, corners=make_plan.corners, height=Slider(0.8, range=0..1), run=Toggle(True))  # -> form_found_surface, kiwi_errors; inputs plan_surface: Brep, corners: list of Curve, run: Boolean
#   port plan_surface: Surface to be form found
# ---------- form_find: Python ----------
import sys

sys.path.insert(1, 'Z:/Documents/ACORN-shells/src')

import acorn_shell
acorn_shell = reload(acorn_shell)
import acorn_shell.generate
acorn_shell.generate = reload(acorn_shell.generate)
from acorn_shell.generate import form_find
form_found_surface, kiwi_errors = form_find(plan_surface, corners, height, run)
# ---------- end form_find ----------
srf = Surface(form_find.form_found_surface)
mesh_breps = MeshBrepsKaramba3D(
    Brep=srf,
    MeshResolution=Slider(0.095, range=0..1),
    EdgeRefinementFactor=0.67,
    PointReduction=Toggle(False),
    SmoothingStepSize=Slider(1, range=0..1),
    SmoothingIterations=Slider(1, range=0..10))  # -> Mesh, Info
build_shell_model = GhPythonScript(mesh=mesh_breps.Mesh, corners=make_plan.corners, thickness=Slider(6, range=0..10))  # -> out, k3d_model; inputs mesh: Mesh, corners: list of Curve
# ---------- build_shell_model: Python ----------
import sys

sys.path.insert(1, 'Z:/Documents/ACORN-shells/src')

import acorn_shell
acorn_shell = reload(acorn_shell)
import acorn_shell.karamba
acorn_shell.karamba = reload(acorn_shell.karamba)
from acorn_shell.karamba import build_shell_model

_,k3d_model = build_shell_model(mesh, corners, thickness)
# ---------- end build_shell_model ----------
analyze = AnalyzeKaramba3D(Model=build_shell_model.k3d_model)  # -> CalculatedModel, MaximumDisplacement_cm, ResultingForceOfGravity_kN, ElasticEnergy_kNm
shellview = ShellViewKaramba3D(Model=analyze.CalculatedModel, IndexOfLayer=0)  # -> Model, MeshesOfRenderedShells, LegendColors, LegendTags
