# Grasshopper definition WIP_example_segmentedShellAnalysis.gh (Grasshopper 1.0.7)
# plug-ins: ACORNshells, karambaGH

# ----
# test surfaces
number_slider = Slider(6, range=0..10)
rectangle = Rectangle(Plane=PlaneXY(0, 0, 0), XSize=number_slider, YSize=number_slider, Radius=0)  # -> Rectangle, Length
pop2d = Populate2D(Region=rectangle.Rectangle, Count=100, Seed=1)
del = DelaunayMesh(Points=pop2d, Plane=PlaneXY(0, 0, 0))
demesh = DeconstructMesh(Mesh=del)  # -> Vertices, Faces, Colours, Normals
conmesh = ConstructMesh(Vertices=demesh.Vertices, Faces=graft(demesh.Faces))  # -> simplify(Mesh)
medges = MeshEdges(Mesh=conmesh)  # -> NakedEdges, InteriorEdges, NonManifoldEdges
boundary = BoundarySurfaces(Edges=medges.NakedEdges)  # -> simplify(flatten(Surfaces))
test_surface = TestSurface()
segments = Surface(boundary)

spring_spacing = Number(Slider(0.5, range=0..1))
segments_2 = Surface([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])
gap_size = Number(Slider(0.1, range=0..0.1))
dom = ConstructDomain(DomainStart="-1", DomainEnd="3")
a_springs = MakeSprings(ShellSegments=test_surface, SpringDistance=spring_spacing, GapSize=gap_size)  # -> OffsetSegments, SegmentSpringLocations, EdgeSpringLocations, SpringLines, GapSize, GapSize_2

# ----
# spring setup
number_slider_2 = Slider(1, range=1..10)
panel = Panel("main direction")
_10º = PowerOf10(Value=Slider(-1, range=-6..10))
multiplication = Multiplication(A=number_slider_2, B=_10º)
_10º_2 = PowerOf10(Value=Slider(7, range=0..10))
_10º_3 = PowerOf10(Value=Slider(3, range=0..10))
_10º_4 = PowerOf10(Value=Slider(3, range=0..10))
multiplication_2 = Multiplication(A=Slider(1, range=0..1), B=_10º_2)
multiplication_3 = Multiplication(A=Slider(1, range=0..1), B=_10º_3)
multiplication_4 = Multiplication(A=Slider(1, range=0..1), B=_10º_4)
vec = VectorXYZ(XComponent=multiplication_3, YComponent=multiplication, ZComponent=multiplication_4)  # -> Vector, Length
vec_2 = VectorXYZ(XComponent=multiplication_2, YComponent=multiplication_2, ZComponent=multiplication_2)  # -> Vector, Length
cross_section = CrossSectionKaramba3D(
    FamilyNameOfCrossSection="DefaultCroSec",
    ElementIdentifier="spring",
    CTranslation_kN_m=vec_2.Vector,
    CRotation_kNm_rad=vec.Vector,
    mode="Spring")

vec_3 = VectorXYZ(XComponent=multiplication, YComponent=multiplication, ZComponent=multiplication)  # -> Vector, Length
thickness_m = Number(Slider(0.06, range=0..0.1))
spring_spacing_2 = Number(Slider(0.2, range=0..1))
shell = Geometry(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)
segments_3 = Surface([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])
gap_size_2 = Number(Slider(0.02, range=0..0.1))
crosec = CrossSectionKaramba(cross_section)
a_springs_2 = MakeSprings(ShellSegments=segments_3, SpringDistance=spring_spacing_2, GapSize=gap_size_2, SpringsCrossSection=crosec)  # -> OffsetSegments, SegmentSpringLocations, EdgeSpringLocations, SpringLines, KarambaSprings, GapSize
Z = UnitZ(Factor=Slider(2, range=0..10))
move = Move(Geometry=shell, Motion=Z)  # -> Geometry, Transform
spring_lines = Geometry(a_springs_2.SpringLines)
segmentspringlocations = Geometry(a_springs_2.SegmentSpringLocations)
karamba_springs = Data(a_springs_2.KarambaSprings)
gapsize = Number(a_springs_2.GapSize)
offsetsegments = Geometry(a_springs_2.OffsetSegments)
number_slider_3 = Slider(1, range=0..1)
number_slider_4 = Slider(3, range=0..10)
number_slider_5 = Slider(1, range=0..1)
number_slider_6 = Slider(0.2, range=0..1)
mesh_breps = MeshBrepsKaramba3D(
    Brep=offsetsegments,
    InclusionPoints=segmentspringlocations,
    MeshResolution=number_slider_6,
    EdgeRefinementFactor=number_slider_3,
    PointReduction=False,
    SmoothingStepSize=number_slider_5,
    SmoothingIterations=number_slider_4)  # -> Mesh, Info

md_slider = MDSlider(
    SliderMode=0,
    slider_value=Point(0.5002947551, 0.4959612591, 0.5),
    x_domain=Domain(0, 1),
    y_domain=Domain(0, 1),
    z_domain=Domain(0, 1))
make_point_load = MakePointLoad(mesh=mesh_breps.Mesh, uv=md_slider, load_kn=Slider(984, range=0..1000))

matselect = MaterialSelectionKaramba3D(menu=[dropdown(3), dropdown(9)])
toggle = BooleanToggle(True)
segments_mesh = Mesh(flatten(mesh_breps.Mesh))
load_pattern = Slider(7, range=1..7)
mesh = Mesh(segments_mesh)
image = ImageSampler(Filter="Colour", Interpolate=False, Umax=1, Umin=0, Vmax=1, Vmin=0, Wrap=1)
dead_load_kn_m2 = Slider(1, range=0..10)
live_load_kn_m2 = Slider(2.5, range=0..10)
segments_mesh_2 = Mesh(segments_mesh)
a_makeshell = MakeKarambaShellElement(ShellSurface=shell, Meshes=mesh, Thickness=thickness_m, Material=matselect, FixedSupport=toggle)  # -> ShellElements, ShellSupports
springs = ElementKaramba3D(karamba_springs)
load_pattern_2 = Integer(load_pattern)

shell_2 = Surface(move.Geometry)
mesh_breps_2 = MeshBrepsKaramba3D(
    Brep=shell_2,
    MeshResolution=number_slider_6,
    EdgeRefinementFactor=number_slider_3,
    PointReduction=False,
    SmoothingStepSize=number_slider_5,
    SmoothingIterations=number_slider_4)  # -> Mesh, Info
mesh_2 = Mesh(mesh_breps_2.Mesh)
thickness_m_2 = Number(thickness_m)
a_makeshell_2 = MakeKarambaShellElement(ShellSurface=shell_2, Meshes=mesh_2, Thickness=thickness_m_2, Material=matselect, FixedSupport=toggle)  # -> ShellElements, ShellSupports
a_shellloads = ShellLoads(Mesh=mesh_2, DeadLoadValue=dead_load_kn_m2, LiveLoadValue=live_load_kn_m2, LiveLoadPattern=load_pattern_2)  # -> Loads, CheckPoints
assemble = AssembleModelKaramba3D(Elem=a_makeshell_2.ShellElements, Support=a_makeshell_2.ShellSupports, Load=a_shellloads.Loads, LimitDistance_m=0.005)  # -> Model, Info, Mass_kg, CenterOfGravity

merge = Merge(Data1=offsetsegments, Data2=shell_2)
undeformed = Geometry(merge)
merge_2 = Merge(Data1=flatten(springs), Data2=flatten(a_makeshell.ShellElements))
element = ElementKaramba(merge_2)
a_shellloads_2 = ShellLoads(Mesh=segments_mesh_2, DeadLoadValue=dead_load_kn_m2, LiveLoadValue=live_load_kn_m2, LiveLoadPattern=load_pattern_2)  # -> Loads, CheckPoints
assemble_2 = AssembleModelKaramba3D(Elem=element, Support=a_makeshell.ShellSupports, Load=a_shellloads_2.Loads, LimitDistance_m=0.005)  # -> Model, Info, Mass_kg, CenterOfGravity
_1stps_only = BooleanToggle(False)
bucking = BooleanToggle(False)
panel_2 = Panel("segmented shell")
panel_3 = Panel("whole shell")
a_results = AnalysisResults(KarambaModel=assemble_2.Model, Percentile="95", Buckling=bucking, FirstPrincipalStressOnly=_1stps_only)  # -> MaxComp, MaxComp_2, MaxCompMeshEs, MaxTens, MaxTens_2, MaxTensMesh, MaximumDisplacement, BucklingFactor, AnalysedModelThI, AnalysedModelThII
a_results_2 = AnalysisResults(KarambaModel=assemble.Model, Percentile="95", Buckling=bucking, FirstPrincipalStressOnly=_1stps_only)  # -> MaxComp, MaxComp_2, MaxCompMeshEs, MaxTens, MaxTens_2, MaxTensMesh, MaximumDisplacement, BucklingFactor, AnalysedModelThI, AnalysedModelThII
panel_4 = Panel(a_results.MaxComp_2)
panel_5 = Panel(a_results.MaximumDisplacement)
panel_6 = Panel(a_results.BucklingFactor)
panel_7 = Panel(a_results_2.BucklingFactor)
panel_8 = Panel(a_results_2.MaxComp_2)
panel_9 = Panel(a_results_2.MaximumDisplacement)
modelview = ModelViewKaramba3D(Model=[a_results.AnalysedModelThI, a_results_2.AnalysedModelThI], ResultFactors=1, ResultCase=-1)  # -> Model, DeformedMesh, DeformedAxes, DeformedModel
modelview_2 = ModelViewKaramba3D(Model=a_results_2.AnalysedModelThI, ResultFactors=1, ResultCase=-1)  # -> Model, DeformedMesh, DeformedAxes, DeformedModel; disabled
license = LicenseKaramba3D()
mesh_3 = Mesh(modelview.DeformedMesh)
shellview = ShellViewKaramba3D(Model=modelview.Model, IndexOfLayer=0)  # -> Model, MeshesOfRenderedShells, LegendColors, LegendTags
shellview_2 = ShellViewKaramba3D(Model=modelview_2.Model, IndexOfLayer=0)  # -> Model, MeshesOfRenderedShells, LegendColors, LegendTags; disabled
panel_10 = Panel(license)
mesh_4 = Mesh(shellview_2.MeshesOfRenderedShells)  # disabled
medges_2 = MeshEdges(Mesh=shellview.MeshesOfRenderedShells)  # -> NakedEdges, InteriorEdges, NonManifoldEdges
geo = Geometry(medges_2.NakedEdges)

cables = Curve()  # disabled
offsetsegments_2 = Geometry(offsetsegments)  # disabled
cables_2 = BooleanToggle(False)  # disabled

# ----
# if input cables disabled, split segments is same as input segments
cables_3 = Curve(cables)  # disabled

embed_cables = EmbedCables(segments=offsetsegments_2, cables=cables_3)  # -> split_segments_2, split_cables_2; disabled
split_cables = Geometry(embed_cables.split_cables_2)  # disabled
filter = StreamFilter(Gate=cables_2, Stream0=offsetsegments_2, Stream1=embed_cables.split_segments_2)  # disabled

# ---- group: PT in mesh for Karamba
number_slider_7 = Slider(0.01, range=0..0.1)  # disabled
curveclosestmeshvert = CurveClosestMeshVert(segments=segments_mesh, cables=split_cables, tol=number_slider_7)  # -> simplify(polyline_2); disabled
number_slider_8 = Slider(16.618, range=0..100)  # disabled
posttensioning = PostTensioning(pt_force=number_slider_8, cables=curveclosestmeshvert)  # -> simplify(pt_intersection_nodes_3), vec_pt_force_4, vec_end_force_2; disabled

# ==== cluster CurveClosestMeshVert
number_slider = Slider(8, range=0..100)
segments = ClusterInput()
cables = ClusterInput()
tol = ClusterInput()
tol_2 = Number(tol)
segments_2 = Mesh(segments)
number_slider_2 = Slider(0.01, range=0..0.01)
cables_2 = Curve(cables)
branch = TreeBranch(Tree=segments_2, Path=number_slider, MaintainPaths=True)
branch_2 = TreeBranch(Tree=cables_2, Path=number_slider, MaintainPaths=True)
mesh = Mesh(segments_2)
curve = Curve(cables_2)

# ---- group: exclude segments without cables
tstat = TreeStatistics(Tree=cables_2)  # -> Paths, Length, Count
branch_3 = TreeBranch(Tree=mesh, Path=tstat.Paths, MaintainPaths=True)

# ----
deconstruct_mesh = DeconstructMesh(Mesh=branch_3)  # -> simplify(Vertices), Faces, Colours, Normals

# ---- group: "manual" cross reference
group = Group(Objects=deconstruct_mesh.Vertices)
lng = ListLength(List=curve)
repeat = RepeatData(Data=group, Length=lng)  # -> simplify(Data)
ungroup = Ungroup(Group=repeat)

# ----
curve_2 = Curve(graft(curve))
pull = PullPoint(Point=ungroup, Geometry=curve_2, ClosestOnly=True)  # -> ClosestPoint, Distance
smaller = SmallerThan(FirstNumber=pull.Distance, SecondNumber=tol_2)  # -> SmallerThan, OrEqualTo
dispatch = Dispatch(List=pull.ClosestPoint, DispatchPattern=smaller.SmallerThan)  # -> ListA, ListB
pt = Point(dispatch.ListA)
sort_along_curve = SortAlongCurve(Points=pt, Curve=curve_2)  # -> simplify(Points), Indices
cullpt = CullDuplicates(Points=sort_along_curve.Points, Tolerance=tol_2, CullMode=3)  # -> Points, Indices, Valence
polyline = PolyLine(Vertices=cullpt.Points, Closed=False)
polyline_2 = ClusterOutput(polyline)

# ==== cluster PostTensioning
cables = ClusterInput()
pt_force = ClusterInput()
cables_2 = Geometry(cables)
pt_force_2 = Number(pt_force)

# ----
# PT forces
pt_kn = Number(pt_force_2)
crv = Curve(cables_2)
flip = FlipCurve(Curve=crv)  # -> Curve, Flag
explode = Explode(Curve=crv, Recursive=True)  # -> Segments, simplify(Vertices)
crv_2 = Curve(crv)
lng = ListLength(List=explode.Vertices)
series = Series(Start=0, Step=1, Count=lng)  # -> simplify(Series)
int = Integer(series)
neg = Negative(Value=int)
eval = EvaluateCurve(Curve=graft(crv_2), Parameter=int)  # -> Point, Tangent, Angle
eval_2 = EvaluateCurve(Curve=graft(flip.Curve), Parameter=neg)  # -> Point, Tangent, Angle
pt_intersection_nodes = Point(eval.Point)

intcrv = Interpolate(Vertices=explode.Vertices, Degree=3, Periodic=False, KnotStyle=1)  # -> Curve, Length, Domain
nurbs = NurbsCurve(Vertices=explode.Vertices, Degree=3, Periodic=False)  # -> Curve, Length, Domain
crvgraph = CurvatureGraph(Curve=intcrv.Curve, Density=5, Scale=Slider(103, range=0..120))
crossref = CrossReference(ListA=graft(pt_kn), ListB=eval.Point, CrossMode=1)  # -> ListA, ListB

amp = Amplitude(Vector=eval_2.Tangent, Amplitude=simplify(crossref.ListA))
amp_2 = Amplitude(Vector=eval.Tangent, Amplitude=simplify(crossref.ListA))
addition = Addition(A=amp_2, B=amp)
vdis = VectorDisplay(Anchor=pt_intersection_nodes, Vector=amp)
vdis_2 = VectorDisplay(Anchor=pt_intersection_nodes, Vector=amp_2)
vec_pt_force = Vector(addition)
vdis_3 = VectorDisplay(Anchor=pt_intersection_nodes, Vector=vec_pt_force)

item = ListItem(List=reverse(amp_2), Index=0, Wrap=True)
item_2 = ListItem(List=reverse(eval.Point), Index=0, Wrap=True)
item_3 = ListItem(List=eval_2.Point, Index=0, Wrap=True)
item_4 = ListItem(List=amp, Index=0, Wrap=True)
vdis_endforce = VectorDisplay(Anchor=item_2, Vector=item)
vdis_endforce_2 = VectorDisplay(Anchor=item_3, Vector=item_4)
merge = Merge(Data1=item, Data2=item_4)
pt_intersection_nodes_2 = Point(pt_intersection_nodes)
vec_end_force = Vector(merge)
vec_pt_force_2 = Vector(addition)
vec_end_force_2 = ClusterOutput(vec_end_force)
move = Move(Geometry=pt_intersection_nodes_2, Motion=vec_pt_force_2)  # -> Geometry, Transform

# ---- group: pair up curve intersection points by index, returns uniques
vec_pt_force_3 = Vector(flatten(vec_pt_force))
pt = Point(flatten(pt_intersection_nodes))
rdpoints = RemoveDuplicatePointsKaramba3D(Point=pt, LimitDistance=0.005)  # -> OutPoint, Info, Indexes
item_5 = ListItem(List=pt, Index=rdpoints.Indexes, Wrap=True)
cp = ClosestPoint(Point=item_5, Cloud=pt)  # -> ClosestPoint, simplify(graft(CPIndex)), Distance
merge_2 = Merge(Data1=simplify(graft(rdpoints.Indexes)), Data2=cp.CPIndex)
item_6 = ListItem(List=vec_pt_force_3, Index=merge_2, Wrap=True)
item_7 = ListItem(List=pt, Index=merge_2, Wrap=True)
ma = MassAddition(Input=item_6)  # -> Result, PartialResults
item_8 = ListItem(List=item_7, Index=0, Wrap=True)
vdisex = VectorDisplayEx(Point=item_8, Vector=ma.Result, Colour=RGB(0, 0, 0), Width=Slider(3, range=0..10))

# ----
pline = PolyLine(Vertices=move.Geometry, Closed=False)  # disabled
curve = Curve(pline)  # disabled
pt_intersection_nodes_3 = ClusterOutput(pt_intersection_nodes_2)
vec_pt_force_4 = ClusterOutput(vec_pt_force_2)

# ==== cluster EmbedCables
segments = ClusterInput()
cables = ClusterInput()
segments_2 = Surface(simplify(segments))
cables_2 = Curve(cables)
surface_curve = SurfaceCurve(Surface=segments_2, Curve=flatten(cables_2))  # -> simplify(Curves), Points, UVPoints, Normals, Parameters, Tangents
trim = TrimTree(Tree=surface_curve.Curves, Depth=1)
srfsplit = SurfaceSplit(Surface=segments_2, Curves=trim)
trim_2 = TrimTree(Tree=srfsplit, Depth=1)
split_segments = Geometry(trim_2)
split_cables = Geometry(trim)
split_segments_2 = ClusterOutput(split_segments)
split_cables_2 = ClusterOutput(split_cables)

# ==== cluster TestSurface
number_slider = Slider(3, range=0..10)
srf = Surface(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)
scale_nu = ScaleNU(Geometry=srf, Plane=PlaneXY(0, 0, 0), ScaleX=1, ScaleY=1, ScaleZ=Slider(1.042, range=0..5))  # -> Geometry, Transform
panel = Panel("1")
srf_2 = Surface(scale_nu.Geometry)
divide = DivideDomain²(Domain=srf_2, UCount=number_slider, VCount=number_slider)
subsrf = Isotrim(Surface=reparameterize(srf_2), Domain=divide)
S = ClusterOutput(subsrf)

# ==== cluster MakePointLoad
load_kn = ClusterInput()
uv = ClusterInput()
mesh = ClusterInput()
load_kn_2 = Number(load_kn)
uv_2 = Point(uv)
mesh_2 = Mesh(mesh)
bbox = BoundingBox(Content=flatten(mesh_2), Plane=PlaneXY(0, 0, 0), UnionBox=True)  # -> Box, Box_2
pdecon = Deconstruct(Point=uv_2)  # -> XComponent, YComponent, ZComponent
Z = UnitZ(Factor=load_kn_2)
box = EvaluateBox(Box=bbox.Box, UParameter=pdecon.XComponent, VParameter=pdecon.YComponent, WParameter=0.5)  # -> Plane, Point, Include
demesh = DeconstructMesh(Mesh=mesh_2)  # -> flatten(Vertices), Faces, Colours, Normals
rev = Reverse(Vector=Z)
cp = ClosestPoint(Point=box.Point, Cloud=demesh.Vertices)  # -> ClosestPoint, CPIndex, Distance
loads = LoadsKaramba3D(ForceVector=rev, Local=False, PosInd=cp.ClosestPoint, LCase=0, mode="Point")
load = ClusterOutput(loads)
